# Grasshopper definition ChatGPT_001.gh (Grasshopper 1.0.7)
# plug-ins: ScriptParasite

panel = Panel("write a ghpython function for creating a plane from a random vector in grasshopper for rhino3d")
panel_2 = Panel("write a ghpython function for creating a random rectangle with rhinoscriptsyntax in grasshopper for rhino3d")
panel_3 = Panel("write a ghpython function for creating random planes with rhino common geometry namespace in grasshopper for rhino3d")
panel_4 = Panel("write a ghpython function for creating random curves with rhinoscriptsyntax in grasshopper for rhino3d")
panel_5 = Panel("write a ghpython function for creating random circular arcs with rhinoscriptsyntax in grasshopper for rhino3d")
panel_6 = Panel("write a ghpython function for creating random points in grasshopper for rhino3d")
panel_7 = Panel("write a ghpython function for creating random circles with rhinoscriptsyntax in grasshopper for rhino3d")
panel_8 = Panel("write a ghpython function for creating random lines with rhinoscriptsyntax in grasshopper for rhino3d")
panel_9 = Panel("write a ghpython function for creating random vectors in grasshopper for rhino3d")
panel_10 = Panel("C:\Users\Sculpture\Desktop\Openai\Key\KeyMichaelWickerson.txt")
# PARAMS
send = BooleanToggle(True)
# ChatGPT into Grasshopper 1.0 Scripts
# WICKERSON STUDIOS
file = ReadFile(File=panel_10, PerLineParse=True)
# geometry
number_slider = Slider(4.411, range=0..10)
construct_point = ConstructPoint(XCoordinate=Slider(2.52, range=0..10), YCoordinate=Slider(1.28, range=0..10), ZCoordinate=Slider(2.5, range=0..10))
chatgpt = GhPythonScript(api_key=file, request=panel_6, send=send)  # -> graft(answer); inputs send: Boolean
# ---------- chatgpt: Python ----------
__author__ = "peter"
__version__ = "2023.01.18"

#calling peters api key on local files, to do: add in more json promts that link to api calls. could be good for uv map generations. 

import rhinoscriptsyntax as rs
import urllib2
import json


url = "https://api.openai.com/v1/completions"


data = json.dumps({ "model": "text-davinci-003", "prompt": request, "temperature": 0.5,  "max_tokens": 1024})
headers = { "Content-Type": "application/json", "Authorization": "Bearer {0}".format(api_key) }

answer = "Send to request to Open AI"

if send:

    req = urllib2.Request(url, data, headers)
    response = urllib2.urlopen(req)


    response_text = response.read()
    response_json = json.loads(response_text)


    answer = response_json["choices"][0]["text"]

print(answer)
# ---------- end chatgpt ----------
panel_11 = Panel(file)
chatgpt_2 = GhPythonScript(api_key=file, request=panel, send=send)  # -> answer; inputs send: Boolean; same code as chatgpt
chatgpt_3 = GhPythonScript(api_key=file, request=panel_3, send=send)  # -> answer; inputs send: Boolean; same code as chatgpt
chatgpt_4 = GhPythonScript(api_key=file, request=panel_2, send=send)  # -> answer; inputs send: Boolean; same code as chatgpt
line = GhPythonScript(numLines=Slider(7, range=0..10))  # -> out, a; inputs numLines: Int32
# ---------- line: Python ----------
__author__ = "Sculpture"
__version__ = "2023.03.02"

import rhinoscriptsyntax as rs
from random import randint

def random_lines(num_lines):
    lines = []
    for i in range(num_lines):
        start_point = [randint(-10, 10), randint(-10, 10), randint(-10, 10)]
        end_point = [randint(-10, 10), randint(-10, 10), randint(-10, 10)]
        lines.append(rs.AddLine(start_point, end_point))
    return lines

a = random_lines(numLines)
# ---------- end line ----------
chatgpt_5 = GhPythonScript(api_key=file, request=panel_8, send=send)  # -> answer; inputs send: Boolean; same code as chatgpt
chatgpt_6 = GhPythonScript(api_key=file, request=panel_4, send=send)  # -> answer; inputs send: Boolean; same code as chatgpt
rectangle = GhPythonScript(
    H=Slider(10, range=0..10),
    W=Slider(10, range=0..10),
    x=Slider(0.95, range=0..1),
    y=Slider(0.93, range=0..1),
    z=Slider(0.62, range=0..1))  # -> out, rectangle
# ---------- rectangle: Python ----------
__author__ = "Sculpture"
__version__ = "2023.03.03"

import rhinoscriptsyntax as rs
import random
import math

#generate the origin point
origin = (0,0,0)
#generate a random vector point
vector = rs.VectorCreate((x,y,z), (random.random(), random.random(), random.random()))
#generate the plane
plane = rs.PlaneFromNormal(origin, vector)
#generate the rectangle
rectangle = rs.AddRectangle(plane, H, W)
# ---------- end rectangle ----------
chatgpt_7 = GhPythonScript(api_key=file, request=panel_5, send=send)  # -> answer; inputs send: Boolean; same code as chatgpt
plane = GhPythonScript(pt=construct_point)  # -> out, a; inputs pt: Point3d
# ---------- plane: Python ----------
__author__ = "Sculpture"
__version__ = "2023.03.03"


import rhinoscriptsyntax as rs
import random

def create_plane_from_random_vector(base_point):
    x = random.uniform(-1,1)
    y = random.uniform(-1,1)
    z = random.uniform(-1,1)
    vector = (x, y, z)
    plane = rs.PlaneFromNormal(base_point, vector)
    return plane

a = create_plane_from_random_vector(pt)
# ---------- end plane ----------
chatgpt_8 = GhPythonScript(api_key=file, request=panel_7, send=send)  # -> graft(answer); inputs send: Boolean; same code as chatgpt
curve = GhPythonScript(numPts=Slider(6, range=0..10), degree=Slider(3, range=1..11))  # -> out, a; inputs numPts: Int32, degree: Int32
# ---------- curve: Python ----------
__author__ = "Sculpture"
__version__ = "2023.03.02"

import rhinoscriptsyntax as rs
import random

def randomCurve():
    # generate random points
    points = []
    for i in range(0,numPts):
        x = random.uniform(-10, 10)
        y = random.uniform(-10, 10)
        z = random.uniform(-10, 10)
        points.append([x,y,z])
    
    # create curve from points
    curve = rs.AddInterpCurve(points, degree)
    
    return curve
    
# call function
a = randomCurve()
# ---------- end curve ----------
chatgpt_9 = GhPythonScript(api_key=file, request=panel_9, send=send)  # -> graft(answer); inputs send: Boolean; same code as chatgpt
xy_plane = GhPythonScript()  # -> out, a
# ---------- xy_plane: Python ----------
__author__ = "Sculpture"
__version__ = "2023.03.03"

import rhinoscriptsyntax as rs
import random

def random_planes(num_planes):
    planes = []
    for i in range(num_planes):
        # create random plane
        plane = rs.CreatePlane(rs.WorldXYPlane(), random.uniform(0, 10))
        # add plane to list
        planes.append(plane)
    # return list of planes
    return planes

a = random_planes(1)
# ---------- end xy_plane ----------
point = GhPythonScript(x=number_slider, y=Slider(3.757, range=0..10), z=Slider(6.487, range=0..10), numPts=Slider(13, range=0..100))  # -> out, a; inputs numPts: Int32
# ---------- point: Python ----------
__author__ = "Sculpture"
__version__ = "2023.03.02"

import rhinoscriptsyntax as rs
import random

def random_points(x_min, x_max, y_min, y_max, z_min, z_max, num_points):
    points = []
    for i in range(num_points):
        x = random.uniform(x_min, x_max)
        y = random.uniform(y_min, y_max)
        z = random.uniform(z_min, z_max)
        point = rs.AddPoint(x, y, z)
        points.append(point)
    return points

a = random_points(-x, x, -y, y, z, z, numPts)
# ---------- end point ----------
vector = GhPythonScript(x=Slider(10.64, range=0..100), y=Slider(12, range=0..100), z=Slider(12, range=0..100), numVts=Slider(7, range=0..10))  # -> out, a; inputs numVts: Int32
# ---------- vector: Python ----------
__author__ = "Sculpture"
__version__ = "2023.03.02"

import rhinoscriptsyntax as rs
import random

def random_vectors(num):
    vectors = []
    for i in range(num):
        x = random.randint(-100, 100)
        y = random.randint(-100, 100)
        z = random.randint(-100, 100)
        vectors.append(rs.CreateVector(x, y, z))
    return vectors
    
a = random_vectors(numVts)
# ---------- end vector ----------
circular_arc = GhPythonScript(numArcs=Slider(3, range=0..10))  # -> out, a; inputs numArcs: Int32
# ---------- circular_arc: Python ----------
__author__ = "Sculpture"
__version__ = "2023.03.02"

import rhinoscriptsyntax as rs
import random

def random_arcs(num_arcs):
    arcs = []
    for i in range(num_arcs):
        center_pt = rs.AddPoint(random.uniform(-50,50),random.uniform(-50,50),0)
        start_pt = rs.AddPoint(random.uniform(-50,50),random.uniform(-50,50),0)
        end_pt = rs.AddPoint(random.uniform(-50,50),random.uniform(-50,50),0)
        arcs.append(rs.AddArc3Pt(start_pt,center_pt,end_pt))
    return arcs

a = random_arcs(numArcs)
# ---------- end circular_arc ----------
circle = GhPythonScript(
    x=Slider(2, range=0..10),
    y=Slider(2, range=0..10),
    z=Slider(4.06, range=0..10),
    radius=Slider(2, range=0..10),
    numCircles=Slider(3, range=0..10))  # -> out, a; inputs numCircles: Int32
# ---------- circle: Python ----------
__author__ = "Sculpture"
__version__ = "2023.03.02"

import rhinoscriptsyntax as rs
import random

def random_circles(num_circles):
    circles = []
    for i in range(num_circles):
        x = random.uniform(-10, 10)
        y = random.uniform(-10, 10)
        z = random.uniform(-10, 10)
        radius = random.uniform(1, 5)
        circles.append(rs.AddCircle((x, y, z), radius))
    return circles

a = random_circles(numCircles)
# ---------- end circle ----------
ghpython_script = GhPythonScript()  # -> Out, A
panel_12 = Panel(chatgpt)
plane_2 = Plane(plane.a)
plane_3 = Plane(xy_plane.a)
# Github Co-Pilot
# #create a rectangle in rhino3d using rhinoscriptsyntax
# #from a random vector point, and parametric values
# import rhinoscriptsyntax as rs
# import random
# import math
# 
# #generate the origin point
# origin = (0,0,0)
# #generate a random vector point
# vector = rs.VectorCreate((0,0,0), (random.random(), random.random(), random.random()))
# #generate the plane
# plane = rs.PlaneFromNormal(origin, vector)
# #generate the rectangle
# rectangle = rs.AddRectangle(plane, 10, 10)
rectangle_2 = Rectangle(rectangle.rectangle)
line_2 = Line(line.a)
vector_2 = Vector(vector.a)
curve_2 = Curve(curve.a)
point_2 = Point(point.a)
construct_point_2 = ConstructPoint(XCoordinate=0, YCoordinate=0, ZCoordinate=0)
panel_13 = Panel(chatgpt_9)
circular_arc_2 = CircularArc(circular_arc.a)
circle_2 = Circle(circle.a)
panel_14 = Panel(chatgpt_8)
panel_15 = Panel(chatgpt_3)
panel_16 = Panel(chatgpt_6)
panel_17 = Panel(chatgpt_7)
panel_18 = Panel(chatgpt_2)
panel_19 = Panel(chatgpt_5)
# chatGPT
panel_20 = Panel(chatgpt_4)
vector_display = VectorDisplay(Anchor=construct_point_2, Vector=vector_2)
ghpython_script_2 = GhPythonScript()  # -> Out, A
c_script = CSharpScript()  # -> Out, A
script_parasite = ScriptParasite(Enable=False, Folder="C:\Users\Sculpture\Desktop\Chatgpt")
